# Grasshopper definition algorithmic_circular_dome.gh (Grasshopper 1.0.7)
# plug-ins: GhPolyhedra, Kangaroo2 Components, karambaGH, Reader, SelectablePreview, Sift, Telepathy, MetaHopper

# ----
# Used Plugins
docinfo = DocumentInfo(AutoUpdate=False, Recursive=False)  # -> DocumentName, DocumentFilePath, Components, Params, _3rdPartyAssemblies
split = TextSplit(Text=docinfo._3rdPartyAssemblies, Separators=",")
item = ListItem(List=split, Index=0, Wrap=True)  # -> flatten(Item)
panel = Panel(item)
panel_2 = Panel("""GhPolyhedra
karambaGH
Reader
SelectablePreview
Sift
Telepathy""")

number_of_domes = Slider(3, range=1..15)

wire_type = Slider(2, range=0..2)
clean_wire = Button()
wirecleaner = WireCleaner(on=clean_wire, wire_type=wire_type)  # -> out, a
# ---------- wirecleaner: Python ----------
from Grasshopper.Kernel import GH_ParamWireDisplay
from Grasshopper.Kernel import GH_RuntimeMessageLevel 

# A dictionary of wire types 
wire_display = {'0':GH_ParamWireDisplay.default, 
                '1':GH_ParamWireDisplay.faint,
                '2':GH_ParamWireDisplay.hidden}

# Get selected components and change the wire display
if on:
    doc = ghenv.Component.OnPingDocument()
    sel_objs = doc.SelectedObjects()
    if not len(sel_objs):
        ghenv.Component.AddRuntimeMessage(GH_RuntimeMessageLevel.Warning, 'Nothing was selected')
    for sel_obj  in sel_objs:
        if hasattr(sel_obj, 'Params'):
            for p in sel_obj.Params.Input:
                if hasattr(p, 'WireDisplay'):
                    p.WireDisplay = wire_display[wire_type]
        else:
            if hasattr(sel_obj, 'WireDisplay'):
                sel_obj.WireDisplay = wire_display[wire_type]
# ---------- end wirecleaner ----------

use_inventory_subsets = BooleanToggle(False)
series = Series(Start=0, Step=1, Count=Slider(10, range=0..10))  # -> graft(Series)

num_graph_dot_size = RemoteSender(Slider(0.5, range=0..1))
int_dome_count = RemoteSender(number_of_domes)

# ---- group: Synthetic Quality Values
panel_3 = Panel("""Grade of Wood

Low=1
Medium=2
High=3""")
merge = Merge(
    Data1="3",
    Data2="3",
    Data3="3",
    Data4="2",
    Data5="2",
    Data6="3",
    Data7="3",
    Data8="3",
    Data9="2",
    Data10="1",
    Data11="1",
    Data12="2",
    Data13="1",
    Data14="3")

# ----
# Load Inventory Building
brep_internalized_geometry = Brep(Tree({0}: [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], {1}: [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], {2}: [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], {3}: [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], {4}: [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], {5}: [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]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))
tstat = TreeStatistics(Tree=brep_internalized_geometry)  # -> Paths, Length, Count
path = ConstructPath(Indices=series)  # -> flatten(Branch)
series_2 = Series(Start=0, Step=1, Count=tstat.Count)
gradient = Gradient(
    LowerLimit="0",
    UpperLimit=tstat.Count,
    Parameter=series_2,
    stops=[0.0441: RGB(255, 228, 196), 0.0598: RGB(255, 224, 192), 0.178: RGB(210, 180, 140), 0.31: RGB(80, 55, 25), 0.408: RGB(128, 64, 0), 0.517: RGB(160, 82, 45), 0.599: RGB(159, 65, 29), 0.737: RGB(184, 134, 11), 0.961: RGB(174, 166, 129)])
split_2 = SplitTree(Data=brep_internalized_geometry, Masks=flatten(path))  # -> Positive, Negative
int = Integer(simplify(graft(merge)))
split_3 = SplitTree(Data=int, Masks=flatten(path))  # -> Positive, Negative
filter = StreamFilter(Gate=use_inventory_subsets, Stream0=brep_internalized_geometry, Stream1=split_2.Positive)
col = Colour(simplify(graft(gradient)))
filter_2 = StreamFilter(Gate=use_inventory_subsets, Stream0=int, Stream1=split_3.Positive)
data = Data(filter)
split_4 = SplitTree(Data=col, Masks=flatten(path))  # -> Positive, Negative
filter_3 = StreamFilter(Gate=use_inventory_subsets, Stream0=col, Stream1=split_4.Positive)
long = LongestList(ListA=filter_2, ListB=data, PaddingMode=2)  # -> ListA, ListB
long_2 = LongestList(ListA=filter_3, ListB=data, PaddingMode=2)  # -> ListA, ListB
int_2 = Integer(flatten(long.ListA))
brep = Brep(data)
col_2 = Colour(long_2.ListA)
col_3 = Colour(filter_3)
preview = CustomPreview(Geometry=brep, Material=col_3)

filter_4 = StreamFilter(Gate=Toggle(False), Stream0=brep)
brep_inventory_geometry = RemoteSender(brep)
col_inventory_colors = RemoteSender(col_2)
pt = Point(Point(0, 0, 0))
pt_2 = Point(Point(1, 0, 0))
ln = Line(StartPoint=pt, EndPoint=pt_2)
brep_inventory_geometry_2 = RemoteReceiver(brep_inventory_geometry)

# ---- group: Scaling parameterized curve
number_slider = Slider(0.23, range=0..1)
number_slider_2 = Slider(0.04, range=0..1)
number_slider_3 = Slider(0.55, range=0..1)
number_slider_4 = Slider(0.15, range=0..1)

# ----
# Redefine Geometry as Oriented Boxes
brep_2 = Brep(brep_inventory_geometry_2)
graft = GraftTree(Tree=brep_2, IncludeEmptyLists=True, IncludeNullItems=True)
debrep = DeconstructBrep(Brep=graft)  # -> Faces, Edges, Vertices
evalsrf = EvaluateSurface(Surface=reparameterize(debrep.Faces), Point="0.5,0.5")  # -> Point, Normal, UDirection, VDirection, Frame
Z = UnitZ(Factor=1)
dprod = DotProduct(VectorA=Z, VectorB=evalsrf.Normal, Unitize=False)
equals = Equality(FirstNumber=dprod, SecondNumber="0")  # -> Equality, Inequality
cull = CullPattern(List=debrep.Faces, CullPattern=equals.Inequality)
planar = IsPlanar(Surface=cull, Interior=True)  # -> Planar, Plane
area = Area(Geometry=cull)  # -> Area, Centroid
sort = SortList(Keys=area.Area, ValuesA=planar.Plane)  # -> Keys, ValuesA
item_2 = ListItem(List=planar.Plane, Index=0, Wrap=True)
item_3 = ListItem(List=sort.ValuesA, Index=0, Wrap=True)  # -> Item1, Item
bbox = BoundingBox(Content=graft, Plane=item_2)  # -> Box, Box_2
bbox_2 = BoundingBox(Content=graft, Plane=item_3.Item1)  # -> Box, Box_2
volume = Volume(Geometry=bbox.Box)  # -> Volume, Centroid
volume_2 = Volume(Geometry=bbox_2.Box)  # -> Volume, Centroid
smaller = SmallerThan(FirstNumber=volume.Volume, SecondNumber=volume_2.Volume)  # -> SmallerThan, OrEqualTo
p_n_c = PickNChoose(Pattern=smaller.SmallerThan, Stream0=bbox_2.Box, Stream1=bbox.Box)
box = Box(p_n_c)

# ---- group: Subdivision parameterized curve
number_slider_5 = Slider(0.35, range=0..1)
number_slider_6 = Slider(0.08, range=0..1)
number_slider_7 = Slider(0.1, range=0..1)
number_slider_8 = Slider(0.1, range=0..1)

# ----
int_dome_count_2 = RemoteReceiver(int_dome_count)

# ---- group: Subdivision parameterized curve / Bounds of subdivision [integer]
dom = ConstructDomain(DomainStart="1", DomainEnd="2")

# ---- group: Subdivision parameterized curve
int_dome_count_3 = RemoteReceiver(int_dome_count)
merge_2 = Merge(Data1=number_slider_5, Data2=number_slider_6, Data3=number_slider_7, Data4=number_slider_8)
lng = ListLength(List=merge_2)
addition = Addition(A=int_dome_count_3, B=1)
subtraction = Subtraction(A=lng, B=1)
divide = DivideCurve(Curve=ln, Count=subtraction, Kinks=False)  # -> Points, Tangents, Parameters
Z_2 = UnitZ(Factor=merge_2)
divide_2 = DivideCurve(Curve=ln, Count=addition, Kinks=False)  # -> Points, Tangents, Parameters
dom_2 = ConstructDomain(DomainStart="1", DomainEnd=int_dome_count_3)
move = Move(Geometry=divide.Points, Motion=Z_2)  # -> Geometry, Transform
subset = SubList(List=divide_2.Points, Domain=dom_2, Wrap=True)  # -> List, Index
subtraction_2 = Subtraction(A=lng, B=1)
sort_pt = SortPoints(Points=move.Geometry)  # -> Points, Indices
Z_3 = UnitZ(Factor=1)
nurbs = NurbsCurve(Vertices=sort_pt.Points, Degree=subtraction_2, Periodic=False)  # -> Curve, Length, Domain
project = ProjectPoint(Point=subset.List, Direction=Z_3, Geometry=nurbs.Curve)  # -> Point, Index
pdecon = Deconstruct(Point=project.Point)  # -> XComponent, YComponent, ZComponent
remap = RemapNumbers(Value=pdecon.ZComponent, Source=Domain(0, 1), Target=dom)  # -> Mapped, Clipped
round = Round(Number=remap.Mapped)  # -> Nearest, Floor, Ceiling

# ---- group: Scaling parameterized curve / Bounds of scale [m]
dom_3 = ConstructDomain(DomainStart="1", DomainEnd="6")

# ---- group: Scaling parameterized curve
merge_3 = Merge(Data1=number_slider, Data2=number_slider_4, Data3=number_slider_2, Data4=number_slider_3)
lng_2 = ListLength(List=merge_3)
subtraction_3 = Subtraction(A=lng_2, B=1)
addition_2 = Addition(A=int_dome_count_2, B=1)
divide_3 = DivideCurve(Curve=ln, Count=subtraction_3, Kinks=False)  # -> Points, Tangents, Parameters
Z_4 = UnitZ(Factor=merge_3)
divide_4 = DivideCurve(Curve=ln, Count=addition_2, Kinks=False)  # -> Points, Tangents, Parameters
dom_4 = ConstructDomain(DomainStart="1", DomainEnd=int_dome_count_2)
move_2 = Move(Geometry=divide_3.Points, Motion=Z_4)  # -> Geometry, Transform
subset_2 = SubList(List=divide_4.Points, Domain=dom_4, Wrap=True)  # -> List, Index
subtraction_4 = Subtraction(A=lng_2, B=1)
sort_pt_2 = SortPoints(Points=move_2.Geometry)  # -> Points, Indices
Z_5 = UnitZ(Factor=1)
nurbs_2 = NurbsCurve(Vertices=sort_pt_2.Points, Degree=subtraction_4, Periodic=False)  # -> Curve, Length, Domain
project_2 = ProjectPoint(Point=subset_2.List, Direction=Z_5, Geometry=nurbs_2.Curve)  # -> Point, Index
pdecon_2 = Deconstruct(Point=project_2.Point)  # -> XComponent, YComponent, ZComponent
remap_2 = RemapNumbers(Value=pdecon_2.ZComponent, Source=Domain(0, 1), Target=dom_3)  # -> Mapped, Clipped

# ---- group: Subdivision parameterized curve / Subdivision values
num = Number(round.Nearest)

# ---- group: Scaling parameterized curve / Scale values
num_2 = Number(remap_2.Mapped)

# ----
icosphere = IcoSphere(Plane=PlaneXY(0, 0, 0), Scale=num_2, Density=num)  # -> flatten(Mesh)

# ---- group: Array domes in a line
spacing_between_domes = Slider(2, range=0..10)
multiplication = Multiplication(A=num_2, B=spacing_between_domes)
gap = Panel("1")
addition_3 = Addition(A=multiplication, B=gap)
item_4 = ListItem(List=addition_3, Index=0, Wrap=True)
ma = MassAddition(Input=addition_3)  # -> Result, PartialResults
subtraction_5 = Subtraction(A=ma.PartialResults, B=item_4)
X = UnitX(Factor=subtraction_5)

# ----
# Sort Other Dimensions by Long Dimension
debox = DeconstructBox(Box=box)  # -> Plane, simplify(X), simplify(Y), simplify(Z)
merge_4 = Merge(Data1=debox.X, Data2=debox.Y, Data3=debox.Z)
sort_2 = SortList(Keys=merge_4)  # -> Keys, ValuesA
item_5 = ListItem(List=sort_2.Keys, Index=0, Wrap=True)  # -> Item, Item1, Item2
pshift = ShiftPaths(Data=item_5.Item, Offset=-1)
pshift_2 = ShiftPaths(Data=item_5.Item1, Offset=-1)
pshift_3 = ShiftPaths(Data=item_5.Item2, Offset=-1)
sort_3 = SortList(Keys=pshift_3, ValuesA=pshift)  # -> Keys, ValuesA
sort_4 = SortList(Keys=pshift_3, ValuesA=pshift_2)  # -> Keys, ValuesA

sample_size_pick_one_every_n = Slider(2, range=1..5)
move_3 = Move(Geometry=icosphere, Motion=X)  # -> Geometry, Transform
int_inventory_sampling = RemoteSender(sample_size_pick_one_every_n)
mesh = Mesh(simplify(graft(move_3.Geometry)))

# ---- group: orient dome using a 5-valence vertex and normal / vertex 0 seems always to be 5-valence...
vn = VertexNeighbours(Mesh=mesh, VertexNumber="0")  # -> Vertex, simplify(Neighbours), Normal

# ---- group: cross section chopping
cluster = Cluster_2(list=sort_3.ValuesA, size=sample_size_pick_one_every_n)
cluster_2 = Cluster_2(list=sort_4.ValuesA, size=sample_size_pick_one_every_n)
cluster_3 = Cluster_2(list=sort_4.Keys, size=sample_size_pick_one_every_n)
box_2 = DomainBox(Base=PlaneXY(0, 0, 0), X=cluster, Y=cluster, Z=cluster_3)  # -> simplify(graft(Box))
division = Division(A=cluster_2, B=cluster)  # -> simplify(graft(Result))
box_elements_at_origin = Box(box_2)
round_2 = Round(Number=division)  # -> Nearest, Floor, Ceiling

# ---- group: orient dome using a 5-valence vertex and normal
volume_3 = Volume(Geometry=mesh)  # -> Volume, Centroid
pl = PlaneNormal(Origin=vn.Vertex, ZAxis=vn.Normal)
xy = XYPlane(Origin=volume_3.Centroid)
orient = Orient(Geometry=mesh, Source=pl, Target=xy)  # -> Geometry, Transform

# ----
# Display Elements after Ripping
diplay_spacing_between_elements = Slider(1, range=0..2)
tstat_2 = TreeStatistics(Tree=box_elements_at_origin)  # -> Paths, Length, Count
series_3 = Series(Start=0, Step=diplay_spacing_between_elements, Count=tstat_2.Count)
X_2 = UnitX(Factor=graft(series_3))  # -> simplify(UnitVector)
match = MatchTree(Tree=X_2, Guide=box_elements_at_origin)
gap_between_split_elements = Slider(0.3, range=0..1)
move_4 = Move(Geometry=box_elements_at_origin, Motion=match)  # -> Geometry, Transform
Y = UnitY(Factor=gap_between_split_elements)
arrlinear = LinearArray(Geometry=move_4.Geometry, Direction=Y, Count=round_2.Floor)  # -> Geometry, Transform
box_elements_after_ripping = RemoteSender(arrlinear.Geometry)

# ---- group: move to origin
volume_4 = Volume(Geometry=orient.Geometry)  # -> Volume, Centroid
vec2pt = Vector2Pt(PointA=volume_4.Centroid, PointB=volume_3.Centroid, Unitize=False)  # -> Vector, Length
move_5 = Move(Geometry=orient.Geometry, Motion=vec2pt.Vector)  # -> Geometry, Transform

# ---- group: middle x coordinate of inventory
int_3 = Integer(series_3)
lng_3 = ListLength(List=int_3)
multiplication_2 = Multiplication(A=lng_3, B=Slider(0.333, range=0..1))
int_4 = Integer(multiplication_2)
item_6 = ListItem(List=int_3, Index=int_4, Wrap=True)
num_inventory_label_x_coordinate = RemoteSender(item_6)

# ----
# Geodesic Dome
num_inventory_label_x_coordinate_2 = RemoteReceiver(num_inventory_label_x_coordinate)
pt_3 = ConstructPoint(XCoordinate=num_inventory_label_x_coordinate_2, YCoordinate=Slider(25.44, range=0..100), ZCoordinate=0)
move_6 = Move(Geometry=move_5.Geometry, Motion=pt_3)  # -> Geometry, Transform
faceb = FaceBoundaries(Mesh=move_6.Geometry)
boundary = BoundarySurfaces(Edges=faceb)
join = BrepJoin(Breps=boundary)  # -> Breps, Closed
box_3 = Box(join.Breps)
debrep_2 = DeconstructBrep(Brep=box_3)  # -> Faces, Edges, Vertices
item_7 = ListItem(List=reverse(debrep_2.Faces), Index=0, Wrap=True)
item_8 = ListItem(List=reverse(debrep_2.Edges), Index=0, Wrap=True)
len = Length(Curve=item_8)
division_2 = Division(A=len, B=2)
Z_6 = UnitZ(Factor=division_2)
neg = Negative(Value=Z_6)
move_7 = Move(Geometry=item_7, Motion=neg)  # -> Geometry, Transform
split_5 = SplitBrep(Brep=join.Breps, Cutter=move_7.Geometry)
item_9 = ListItem(List=split_5, Index=0, Wrap=True)
mesh_2 = MeshBrep(
    Brep=item_9,
    Settings={GridMaxCount=0, GridMinCount=16, JaggedSeams=False, MaxEdgeLength=0, MinEdgeLength=0.0001, MinTolerance=0, Refine=True, RefineAngle=0, RelativeTolerance=0.65, SimplePlanes=True, Tolerance=0})
medges = MeshEdges(Mesh=mesh_2)  # -> NakedEdges, InteriorEdges, NonManifoldEdges
crv = Curve([medges.InteriorEdges, medges.NakedEdges])
X_3 = UnitX(Factor=Slider(10, range=0..10))
arrlinear_2 = LinearArray(Geometry=crv, Direction=X_3, Count=Slider(1, range=0..10))  # -> flatten(Geometry), Transform
mesh_design_mesh = RemoteSender(mesh_2)
crv_design_curves = RemoteSender(arrlinear_2.Geometry)

# ---- group: origin
Y_2 = UnitY(Factor=Slider(10, range=10..30))
pt_4 = Point(pt_3)
move_8 = Move(Geometry=pt_4, Motion=Y_2)  # -> Geometry, Transform
pt_graph_origin = RemoteSender(move_8.Geometry)

# ----
debox_2 = DeconstructBox(Box=box_elements_after_ripping)  # -> Plane, X, Y, Z
num_3 = Number(flatten(debox_2.X))
num_4 = Number(flatten(debox_2.Y))
num_5 = Number(flatten(debox_2.Z))
num_inventory_cross_section_x = RemoteSender(num_3)
num_inventory_cross_section_y = RemoteSender(num_4)

Z_7 = UnitZ(Factor=debox_2.Z)
division_3 = Division(A=Z_7, B="2")
volume_5 = Volume(Geometry=box_elements_after_ripping)  # -> Volume, Centroid
neg_2 = Negative(Value=division_3)
move_9 = Move(Geometry=volume_5.Centroid, Motion=neg_2)  # -> Geometry, Transform
move_10 = Move(Geometry=volume_5.Centroid, Motion=division_3)  # -> Geometry, Transform
ln_2 = Line(StartPoint=move_9.Geometry, EndPoint=move_10.Geometry)  # -> flatten(Line)
line_element_centerline = Line(ln_2)
line_inventory_curves = RemoteSender(line_element_centerline)

cset = CreateSet(List=num_3)  # -> Set, Map
panel_4 = Panel(cset.Set)

# ---- group: floor area
debox_3 = DeconstructBox(Box=box_3)  # -> Plane, X, Y, Z
cluster_4 = Cluster(domain=debox_3.X)
cluster_5 = Cluster(domain=debox_3.Y)
division_4 = Division(A=cluster_4, B=2)
division_5 = Division(A=cluster_5, B=2)
min = Minimum(A=division_4, B=division_5)
pow = Power(A=min, B="2")
pi = Pi(Factor=pow)  # -> flatten(Output)
num_dome_floor_area = RemoteSender(pi)

# ----
# Karamba FEA
crv_design_curves_2 = RemoteReceiver(crv_design_curves)
mesh_design_mesh_2 = RemoteReceiver(mesh_design_mesh)
crv_2 = Curve(crv_design_curves_2)
mesh_3 = Mesh(mesh_design_mesh_2)
end = EndPoints(Curve=crv_2)  # -> Start, End
rdpoints = RemoveDuplicatePointsKaramba3D(Point=[end.Start, end.End], LimitDistance=0.005)  # -> OutPoint, Info, Indexes
pdecon_3 = Deconstruct(Point=rdpoints.OutPoint)  # -> XComponent, YComponent, ZComponent
sort_5 = SortList(Keys=pdecon_3.ZComponent)  # -> Keys, ValuesA
item_10 = ListItem(List=sort_5.Keys, Index=0, Wrap=True)
num_6 = Number("0.00001")
expression = Expression(zmin=item_10, z=pdecon_3.ZComponent, tol=num_6, Expression="if(abs(zmin-z)<tol,true,false)")
faceb_2 = FaceBoundaries(Mesh=mesh_3)
boundary_2 = BoundarySurfaces(Edges=flatten(faceb_2))
cull_2 = CullPattern(List=rdpoints.OutPoint, CullPattern=expression)
mesh_breps = MeshBrepsKaramba3D(
    Brep=boundary_2,
    MeshResolution=Slider(100, range=0..100),
    EdgeRefinementFactor=0.67,
    PointReduction=False,
    SmoothingStepSize=0,
    SmoothingIterations=5)  # -> Mesh, Info
panel_5 = Panel("5")
Z_8 = UnitZ(Factor=Slider(4, range=1..5))  # -> expr("-x", UnitVector)
supp = SupportKaramba3D(PosInd=cull_2, menu=[buttons(on, on, on, off, off, off)])
cross_section = CrossSectionKaramba3D(
    FamilyNameOfCrossSection="DefaultCroSec",
    Material=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,
    Height_cm="5",
    UpperFlangeWidth_cm="5",
    LowerFlangeWidth_cm="5",
    mode="Trapezoid")
matselect = MaterialSelectionKaramba3D(menu=[dropdown(4), dropdown(1)])
linetobeam = LineToBeamKaramba3D(Line=crv_2, New=True, Remove=True, LimitDistance_m=0.005, Bending=Toggle(False))  # -> Element, Points, Info
loads = LoadsKaramba3D(Vector=Z_8, Mesh=mesh_breps.Mesh, LCase=0, mode="MeshLoad -Const.", menu=[buttons(off, on, off), buttons(off, on)])
assemble = AssembleModelKaramba3D(Elem=linetobeam.Element, Support=supp, Load=loads, CrossSection=cross_section, Material=matselect, LimitDistance_m=0.005)  # -> Model, Info, Mass_kg, CenterOfGravity
analyze = AnalyzeKaramba3D(Model=assemble.Model)  # -> CalculatedModel, MaximumDisplacement_cm, ResultingForceOfGravity_kN, ElasticEnergy_kNm
disassemble = DisassembleMaterialKaramba3D(Material=matselect)  # -> Material, TypeOfMaterial, FamilyNameOfMaterial, NameOfMaterial, ElemIdentifiers, Color, YoungsModulusKNCm2Dir12, InPlaneShearModulus_kN_cm2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
modelview = ModelViewKaramba3D(Model=analyze.CalculatedModel, ResultFactors=1, ResultCase=-1)  # -> Model, DeformedMesh, DeformedAxes, DeformedModel; disabled
b_forces = BeamForcesKaramba3D(AnalyzedModel=analyze.CalculatedModel, LCase=-1, MaximumDistanceBetweenResults_m=-1, NumberOfResultsPerBeamElement=2)  # -> AnalyzedModel, NormalForce_kN, ShearForceVz_kN, ShearForceVy_kN, BendingMomentMt_kNm, BendingMomentMy_kNm, BendingMomentMz_kNm
beamview = BeamViewKaramba3D(Model=modelview.Model)  # -> Model, MeshesOfRenderedBeams, DeformedBeamAxes, LegendColors, LegendTags; disabled
legend = Legend(Colour=beamview.LegendColors, Tags=beamview.LegendTags, LegendType=1)  # disabled
item_11 = ListItem(List=b_forces.NormalForce_kN, Index=0, Wrap=True)  # -> flatten(Item)

line_inventory_curves_2 = RemoteReceiver(line_inventory_curves)
crv_design_curves_3 = RemoteReceiver(crv_design_curves)

# ----
# inventory cross section x
# inventory cross section y
num_inventory_cross_section_x_2 = RemoteReceiver(num_inventory_cross_section_x)
num_inventory_cross_section_y_2 = RemoteReceiver(num_inventory_cross_section_y)
num_7 = Number(num_inventory_cross_section_y_2)
num_8 = Number(num_inventory_cross_section_x_2)

target_load_demand_kn = Number(item_11)

# ---- group: design curves
crv_3 = Curve(crv_design_curves_3)

# ---- group: inventory curves
crv_4 = Curve(line_inventory_curves_2)

# ---- group: Allowable stress [kN/cm^2], assumed 0.5*yield stress
num_9 = Number(disassemble.YieldStrengthKNCm2Dir12)
multiplication_3 = Multiplication(A=num_9, B="0.5")

# ---- group: Elastic modulus [kN/cm^2]
num_10 = Number(disassemble.YoungsModulusKNCm2Dir12)

# ---- group: Lengths in inventory
len_2 = Length(Curve=crv_4)

# ---- group: Lengths in design
len_3 = Length(Curve=crv_3)

# ----
num_dome_floor_area_2 = RemoteReceiver(num_dome_floor_area)

# ---- group: penalty
num_11 = Number("1e7")

# ----
# Julia Matching backend
panel_6 = Panel("\jl_scripts\hungarian_upcycling.jl")
rhino_doc_dir = RhinoDocDir()  # -> rhino_doc_dir
# ---------- rhino_doc_dir: Python ----------
import scriptcontext as sc
from os import path

rhino_doc_dir = path.abspath(path.dirname(sc.doc.Path))
# ---------- end rhino_doc_dir ----------
concat = Concatenate(FragmentA=rhino_doc_dir, FragmentB=panel_6)
compute_matching = BooleanToggle(False)
reload = Button()
python = GhPythonScript(x=concat)  # -> a
# ---------- python: Python ----------
import os
a = os.path.abspath(x)
assert os.path.exists(a)
# ---------- end python ----------
python_2 = GhPythonScript(
    compute=compute_matching,
    reload=reload,
    jl_script_path=python,
    demand_lengths=len_3,
    supply_lengths=len_2,
    demand_loads=target_load_demand_kn,
    supply_cross_sec_xs=num_8,
    supply_cross_sec_ys=num_7,
    allowable_stress=multiplication_3,
    elastic_modulus=num_10,
    penalty=num_11)  # -> out, assignment, cost, material_coverage; inputs demand_lengths: list, supply_lengths: list, demand_loads: list, supply_cross_sec_xs: list, supply_cross_sec_ys: list
# ---------- python_2: Python ----------
import Grasshopper.DataTree as DataTree # Add, AddRange(list, GHPath(i, j))
import Grasshopper.Kernel.Data.GH_Path as GHPath
import System
from System.Collections.Generic import List

from ghpythonlib.treehelpers import list_to_tree, tree_to_list

import math
import scriptcontext as sc
import ghpythonremote
from time import time
np = sc.sticky['numpy']
rpy = sc.sticky['rpy']
jl = sc.sticky['julia']

##############################

#st_time = time()
np_demand_lengths = ghpythonremote.deliver(rpy, demand_lengths)
np_supply_lengths = ghpythonremote.deliver(rpy, supply_lengths)
np_demand_loads = ghpythonremote.deliver(rpy, demand_loads)
np_supply_cross_sec_xs = ghpythonremote.deliver(rpy, supply_cross_sec_xs)
np_supply_cross_sec_ys = ghpythonremote.deliver(rpy, supply_cross_sec_ys)
#total_time = time() - st_time
#print('numpy data ghpyremote sending takes {} ms'.format(total_time*1e3))

#st_time = time()
try:
    jl.Main.eval('println("Julia env inititated.")')
except:
    jl.Julia()

try:
    jl.Main.eval('using Main:hungarian_upcycling_assignment')
    if reload:
        raise RuntimeError()
except:
    jl.Main.include(jl_script_path)
#total_time = time() - st_time
#print('Julia setup takes {} ms'.format(total_time*1e3))

if compute:
    st_time = time()

    _assignment, _cost_opt, _material_cov = \
        jl.Main.hungarian_upcycling_assignment(np_demand_lengths, np_supply_lengths, np_demand_loads, 
            np_supply_cross_sec_xs, np_supply_cross_sec_ys, 
            allowable_stress, elastic_modulus, penalty)
    if _assignment is not None:
        assert np.all(_assignment>0), 'Assignment has zero indices (which should all >= 1).'
        print('Cost {}'.format(_cost_opt))
        # Julia is 1-indexed
        _assignment -= 1
        total_time = time() - st_time
        print('Julia computation used {:.1f} mins'.format(total_time/60))
        print('~ {:.1f} secs'.format(total_time))
        if _cost_opt >= penalty:
            assignment = None
            material_coverage = 0.0
        else:
            assignment_list = ghpythonremote.obtain(_assignment.tolist())
            assignment = [int(v) for v in assignment_list]
            material_coverage = float(_material_cov)
        cost = _cost_opt
    else:
        print("Inventory not large enough.")
        assignment = None
        cost = penalty*len(demand_loads)
        material_coverage = 0.0
# ---------- end python_2 ----------
num_12 = Number(python_2.cost)
num_13 = Number(python_2.material_coverage)
int_5 = Integer(python_2.assignment)
panel_7 = Panel(python_2.out)
panel_8 = Panel(num_12)

# ---- group: domes floor area
num_14 = Number(num_dome_floor_area_2)
panel_9 = Panel(num_14)

# ---- group: Import remote python modules
python_3 = PythonScript()  # -> rhino_doc_dir; same code as rhino_doc_dir
panel_10 = Panel(python_3)
panel_11 = Panel("""numpy
julia""")
restart_python = BooleanToggle(True)
list = ValueList({"CRITICAL", "ERROR", "WARNING", "INFO", "DEBUG", "NOTSET"}, selected="DEBUG")
ghpythonremote = GHPythonRemote(location="conda://py27", run=restart_python, modules=panel_11, log_level=list, working_dir=panel_10)  # -> out, linked_modules, rpy; inputs run: Boolean, modules: list
# ---------- ghpythonremote: Python ----------
import sys
import scriptcontext
import logging
import inspect
import ghpythonremote
from ghpythonremote.connectors import GrasshopperToPythonRemote
from os import path
from time import sleep

local_log_level = getattr(logging, log_level, logging.WARNING)
logger = logging.getLogger('ghpythonremote')
logger.setLevel(local_log_level)
ch = logging.StreamHandler()
ch.setLevel(local_log_level)
formatter = logging.Formatter('%(levelname)s: %(name)s:\n%(message)s')
ch.setFormatter(formatter)
logger.handlers = []
logger.addHandler(ch)
logger = logging.getLogger('ghpythonremote.GH_to_python')

ROOT = path.abspath(path.dirname(inspect.getfile(ghpythonremote)))
rpyc_server_py = path.join(ROOT, 'pythonservice.py')

# Set connection to CLOSED if this is the first run
# and initialize set of linked modules
try:
    remote_python_status
except NameError:
    remote_python_status = 'CLOSED'
    lkd_modules = set()

# Wait for connection to connect or terminate
timer = 0
while remote_python_status == 'CONNECTING' or remote_python_status == 'CLOSING':
    sleep(1)
    timer += 1
    if timer == 10:
        try:
            gh2py_manager.__exit__(*sys.exc_info())
        except Exception:
            pass
        remote_python_status = 'CLOSED'
        lkd_modules = set()
        raise RuntimeError("Connection left in an inconsistent state and not returning. Reset everything.")

if run:
    if not remote_python_status == 'OPEN':
        remote_python_status = 'CONNECTING'
        gh2py_manager = GrasshopperToPythonRemote(rpyc_server_py, location=location, timeout=10,
                                                  port=None, log_level=log_level, working_dir=working_dir)
        gh2py = gh2py_manager.__enter__()
        remote_python_status = 'OPEN'

    # Stuff that we can reach
    rpymod = gh2py.py_remote_modules  # A getter function for a named python module
    rpy = gh2py.connection  # Represents the remote instance root object
    scriptcontext.sticky['rpy'] = rpy
    # Add modules
    for mod in modules:
        try:
            scriptcontext.sticky[mod] = rpymod(mod)
            lkd_modules.add(mod)
        except ImportError:
            gh2py_manager.__exit__(*sys.exc_info())
            raise

elif not remote_python_status == 'CLOSED':
    remote_python_status = 'CLOSING'
    # Remove linked modules
    for mod in lkd_modules:
        del scriptcontext.sticky[mod]
    del scriptcontext.sticky['rpy']
    gh2py_manager.__exit__(*sys.exc_info())
    lkd_modules = set()
    remote_python_status = 'CLOSED'

# Change variable name because ghpython resets outputs to None before each run
linked_modules = lkd_modules

logger.info('GH to python connection is {}'.format(remote_python_status))
# ---------- end ghpythonremote ----------
python_4 = PythonScript(module_names=ghpythonremote.linked_modules)  # -> import_statements; inputs module_names: list
# ---------- python_4: Python ----------
import_statements = ["import scriptcontext as sc"]
for module_name in module_names:
    import_statements.append("{0} = sc.sticky['{0}']".format(module_name))

if len(module_names) == 0:
    import_statements = []
# ---------- end python_4 ----------
panel_12 = Panel(python_4)
panel_13 = Panel(ghpythonremote.out)

# ----
ma_2 = MassAddition(Input=num_14)  # -> Result, PartialResults

# ---- group: total floor area
num_15 = Number(flatten(ma_2.Result))
panel_14 = Panel(num_15)

# ----
box_elements_after_ripping_2 = RemoteReceiver(box_elements_after_ripping)

col_inventory_colors_2 = RemoteReceiver(col_inventory_colors)
int_inventory_sampling_2 = RemoteReceiver(int_inventory_sampling)
col_4 = Colour(col_inventory_colors_2)
cluster_6 = Cluster_2(list=col_4, size=int_inventory_sampling_2)

# ---- group: inventory color / inventory geometries
geo = Geometry(flatten(box_elements_after_ripping_2))

# ---- group: inventory color / design curves
crv_5 = Curve(crv_3)

# ---- group: inventory color / inventory curves
crv_6 = Curve(crv_4)

# ----
use_julia_backend = BooleanToggle(False)

# ---- group: inventory color / inventory colors
col_5 = Colour(flatten(cluster_6))

# ----
graft_2 = GraftTree(Tree=col_5, IncludeEmptyLists=True, IncludeNullItems=True)  # -> simplify(Tree)

# ----
# Inventory Display
number_slider_9 = Slider(0.9, range=0..1)
box_elements_after_ripping_3 = RemoteReceiver(box_elements_after_ripping)
material = CreateMaterial(Diffuse=cluster_6, Specular=RGB(255, 255, 255), Emission=RGB(0, 0, 0), Transparency=number_slider_9, Shine=0)
brep_3 = Brep(simplify(box_elements_after_ripping_3))
graft_3 = GraftTree(Tree=material, IncludeEmptyLists=True, IncludeNullItems=True)
preview_2 = CustomPreview(Geometry=brep_3, Material=graft_3)

# ---- group: inventory color / design
crv_7 = Curve(crv_5)

# ---- group: inventory color / inventory
crv_8 = Curve(crv_6)

# ---- group: toggle matching line viz here!
viz_matching_line = BooleanToggle(False)

# ----
# Design Space Exploration
panel_15 = Panel("feasible_match-floor_data.csv")
rhino_doc_dir_2 = RhinoDocDir()  # -> rhino_doc_dir; same code as rhino_doc_dir
txt = Text("feasible_MOO_match-coverage_data.csv")
concat_2 = Concatenate(FragmentA=rhino_doc_dir_2, FragmentA_2="/data/", FragmentB=txt)
reader = Reader(Filepath=concat_2, Separator=",")
number_slider_10 = Slider(100, range=10..100)
pt_graph_origin_2 = RemoteReceiver(pt_graph_origin)
num_graph_dot_size_2 = RemoteReceiver(num_graph_dot_size)
num_graph_dot_size_3 = RemoteReceiver(num_graph_dot_size)
pt_graph_origin_3 = RemoteReceiver(pt_graph_origin)
addition_4 = Addition(A=number_slider_10, B="10")
addition_5 = Addition(A=number_slider_10, B="10")
Y_3 = UnitY(Factor=addition_4)
X_4 = UnitX(Factor=addition_5)
move_11 = Move(Geometry=pt_graph_origin_3, Motion=X_4)  # -> Geometry, Transform
move_12 = Move(Geometry=pt_graph_origin_3, Motion=Y_3)  # -> Geometry, Transform
dots = DotDisplay(Point=pt_graph_origin_3, Colour=ColourSwatch(SwatchColor=RGB(0, 0, 0)), Size=num_graph_dot_size_3)
ln_3 = Line(StartPoint=pt_graph_origin_3, EndPoint=move_12.Geometry)
ln_4 = Line(StartPoint=pt_graph_origin_3, EndPoint=move_11.Geometry)
txt_2 = Text(txt)
midpt = CurveMiddle(Curve=ln_3)
X_5 = UnitX(Factor=1)
pt_5 = Point("2.0,0,0")
midpt_2 = CurveMiddle(Curve=ln_4)
number_slider_11 = Slider(1.5, range=0..10)
tmatch = MatchText(Text=txt_2, RegEx="floor", Case=True)
subtraction_6 = Subtraction(A=midpt, B=pt_5)
Y_4 = UnitY(Factor=1)
neg_3 = Negative(Value=X_5)
pt_6 = Point("0,2.0,0")
subtraction_7 = Subtraction(A=midpt_2, B=pt_6)
filter_5 = StreamFilter(Gate=tmatch, Stream0="material coverage", Stream1="total floor area")
panel_16 = Panel(txt_2)
panel_17 = Panel(tmatch)
pl_2 = ConstructPlane(Origin=subtraction_6, XAxis=Y_4, YAxis=neg_3)
tag = TextTag3D(Location=pl_2, Text=filter_5, Size=number_slider_11, Justification=7)
tag_2 = TextTag3D(Location=subtraction_7, Text="matching score", Size=number_slider_11, Justification=7)

# ----
# get rid of column names
panel_18 = Panel("{0}")
split_6 = SplitTree(Data=reader, Masks=flatten(panel_18))  # -> Positive, Negative

panel_19 = Panel(split_6.Positive)
split_7 = SplitList(List=split_6.Negative, Index="9")  # -> simplify(ListA), simplify(ListB)
item_12 = ListItem(List=split_7.ListB, Index=0, Wrap=True)  # -> Item, Item1
neg_4 = Negative(Value=item_12.Item1)
cluster_7 = Cluster_3(number=item_12.Item, domain_end=number_slider_10)
cluster_8 = Cluster_3(number=neg_4, domain_end=number_slider_10)
pt_7 = ConstructPoint(XCoordinate=cluster_7, YCoordinate=cluster_8, ZCoordinate=0)
long_3 = LongestList(ListA=pt_graph_origin_2, ListB=pt_7, PaddingMode=2)  # -> ListA, ListB
match_2 = MatchTree(Tree=long_3.ListA, Guide=pt_7)
addition_6 = Addition(A=match_2, B=pt_7)
dots_2 = DotDisplay(Point=addition_6, Colour=ColourSwatch(SwatchColor=RGB(15, 131, 255)), Size=num_graph_dot_size_2)
selpv = SelectablePreview(Geometry=addition_6, lock=False, maintain=False, order=False, selectedobject="505")  # -> Geometry, Path, Index
item_13 = ListItem(List=selpv.Path, Index=0, Wrap=True)  # -> Item1, Item
num_16 = Number(split_7.ListA)
branch = TreeBranch(Tree=split_7.ListB, Path=item_13.Item1, MaintainPaths=True)
branch_2 = TreeBranch(Tree=num_16, Path=item_13.Item1, MaintainPaths=True)
dpath = DeconstructPath(Branch=item_13.Item1)
panel_20 = Panel(item_13.Item1)
subtraction_8 = Subtraction(A=dpath, B=1)
panel_21 = Panel(branch)
sift = Sift(
    Variables=[number_slider, number_slider_4, number_slider_2, number_slider_3, number_slider_5, number_slider_6, number_slider_7, number_slider_8, number_of_domes],
    DesignMap=num_16,
    Index=subtraction_8)
panel_22 = Panel(sift)
panel_23 = Panel(branch_2)

# ----
# C# Matching backend
python_5 = GhPythonScript(
    demand_lengths=len_3,
    supply_lengths=len_2,
    demand_loads=target_load_demand_kn,
    supply_cross_sec_xs=num_8,
    supply_cross_sec_ys=num_7,
    allowable_stress=multiplication_3,
    elastic_modulus=num_10,
    penalty=num_11)  # -> out, cost_matrix; inputs demand_lengths: list, supply_lengths: list, demand_loads: list, supply_cross_sec_xs: list, supply_cross_sec_ys: list
# ---------- python_5: Python ----------
import Grasshopper.DataTree as DataTree # Add, AddRange(list, GHPath(i, j))
import Grasshopper.Kernel.Data.GH_Path as GHPath
import System
from System.Collections.Generic import List
import math

from ghpythonlib.treehelpers import list_to_tree, tree_to_list
##############################

def compute_moment_of_inertia(b,h):
    # input: b,h in meter
    # return: I in cm^4
    return (b*pow(h,3)/12)*1e8

def compute_strength_capacity(b,h,Fy):
    # input: b,h in meter;
    #        Fy in kN/cm^2: allowable stress
    # return: Fmax in kN
    return b*h*1e4*Fy

def compute_buckling_capacity(b,h,L,E):
    # input: b,h,L in meter, E in kN/cm^2
    # return: buckling capacity R in kN
    I = compute_moment_of_inertia(b,h)
    return (1.0/3)*pow(math.pi,2)*E*I/pow(L,2)*1e-4
    
######################################

demand_num = len(demand_lengths)
supply_num = len(supply_lengths)
assert demand_num <= supply_num, 'demand_num ({}) > supply_num ({})'.format(demand_num, supply_num)
assert len(demand_loads) == demand_num
assert len(supply_cross_sec_xs) == supply_num
assert len(supply_cross_sec_ys) == supply_num

cost_matrix = [[0.0 for _ in range(supply_num)] for _ in range(demand_num)]

for i in range(demand_num):
    for j in range(supply_num):
        Li = demand_lengths[i]
        Lj = supply_lengths[j]
        if Li > Lj:
            # length constraint violated
            cost_matrix[i][j] = penalty
        else:
            demand_load = demand_loads[i]
            b = max(supply_cross_sec_xs[j], supply_cross_sec_ys[j])
            h = min(supply_cross_sec_xs[j], supply_cross_sec_ys[j])
            tensile_capacity = compute_strength_capacity(b,h,allowable_stress)
            capacity = 0.0
            if demand_load >= 0:
                # tensile demand
                capacity = tensile_capacity
            else:
                # compressive demand
                L = min(Li,Lj) # in meter
                buckling_capacity = compute_buckling_capacity(b,h,L,elastic_modulus)
                compressive_capacity = min(buckling_capacity, tensile_capacity)
                capacity = min(tensile_capacity, compressive_capacity)
            if abs(demand_load) > capacity:
                # capacity constraint violated
                cost_matrix[i][j] = penalty
            else:
                # euclidean distance
                cost_matrix[i][j] = math.sqrt(pow(Li-Lj,2)+\
                                    pow(abs(capacity)-abs(demand_load),2))

cost_matrix = list_to_tree(cost_matrix, source=[])
# ---------- end python_5 ----------
num_17 = Number(python_5.cost_matrix)
num_18 = Number(num_11)

dam = DataDam(DataA=num_17, BufferDelay=10000000, BufferMode=0)

# ---- group: using external dll
c_script = CSharpScript(
    distance_matrix=dam,
    integral_scale="1e2",
    penalty=num_18,
    Reference="C:\USERS\MATTJ\DOCUMENTS\ETH\ALGORITHMIC_CIRCULAR_DESIGN\HungarianAlgorithm.dll")  # -> out, matched_A2B_ids, cost_star; inputs distance_matrix: tree of Double, integral_scale: Double, penalty: Double
# ---------- c_script: C# usings ----------
using System.IO;
using System.Linq;
using System.Data;
using System.Drawing;
using System.Reflection;
using System.Windows.Forms;
using System.Xml;
using System.Xml.Linq;
using System.Runtime.InteropServices;

using Rhino.DocObjects;
using Rhino.Collections;
using GH_IO;
using GH_IO.Serialization;

using HungarianAlgorithm;
using HungarianAlgorithm.Extensions;
# ---------- c_script: C# ----------
    // dimension of the input lists
    int n = distance_matrix.BranchCount;
    int m = distance_matrix.Branch(0).Count;

    if(0 == m * n)
    {
      this.Component.AddRuntimeMessage(Grasshopper.Kernel.GH_RuntimeMessageLevel.Error, "intput tree data branch dimension = 0!");
      return;
    }

    if(n > m)
    {
      this.Component.AddRuntimeMessage(Grasshopper.Kernel.GH_RuntimeMessageLevel.Error,
        "Branch count must be smaller than the size of each branch! (design pt number should be smaller than inventory pts!)");
      return;
    }
    // The algorithm doesn't always produce the most optimal result, when the input contains more columns (m) than rows (n).
    // To overcome this issue, square the dimensions of the input before passing it to the algorithm.

    //    var watch = new System.Diagnostics.Stopwatch();
    //    if(timing)
    //    {
    //      watch.Start();
    //    }

    // generate the cost matrix
    int[,] costs = new int[m, m];

    for(int i = 0; i < m; i++)
    {
      for(int j = 0; j < m; j++)
      {
        if(i >= n)
        {
          // fill the matrix to be square
          costs[i, j] = (int) Int32.MaxValue;
        }
        else
        {
          // the algorithm only takes integral inputs, scale it up here.
          double scaled_cost = distance_matrix.Branch(i)[j] * integral_scale;
          if(scaled_cost > Int32.MaxValue) {
            throw new OverflowException(
              //            this.Component.AddRuntimeMessage(Grasshopper.Kernel.GH_RuntimeMessageLevel.Error,
              String.Format("Cost at ({0},{1}): {2} bigger than maximal integral value {3}", i, j, scaled_cost, Int32.MaxValue));
          }
          costs[i, j] = (int) scaled_cost;
//          if (costs[i, j] < 1e-6)
//          {
//            Print(String.Format("{0}",costs[i, j]));
//          }
        }
      }
    }

    int[,] costs_copy = (int[,]) costs.Clone();
    double final_cost = 0;
    
    int[] matched_pts2_ids = HungarianAlgorithm.HungarianAlgorithm.FindAssignments(costs);

    DataTree<int> matched_A2B = new DataTree<int>();
    for(int i = 0; i < n; i++)
    {
      var pth = new GH_Path(i);
      final_cost += (double) costs_copy[i, matched_pts2_ids[i]] / integral_scale;
      matched_A2B.Add(matched_pts2_ids[i], pth);
    }

    if(final_cost > penalty)
    {
      this.Component.AddRuntimeMessage(Grasshopper.Kernel.GH_RuntimeMessageLevel.Error,
        "Computed assignment cost > penalty terms!");
      throw new Exception("Infeasible matching.");
    }

    //    if(timing)
    //    {
    //      watch.Stop();
    //      Print(String.Format("Execution Time: {0} ms", watch.ElapsedMilliseconds));
    //    }

    matched_A2B_ids = matched_A2B;
    cost_star = final_cost;
# ---------- end c_script ----------

# ----
int_6 = Integer(flatten(c_script.matched_A2B_ids))
num_19 = Number(c_script.cost_star)
panel_24 = Panel(num_19)

filter_6 = StreamFilter(Gate=use_julia_backend, Stream0=num_19, Stream1=num_12)

# ---- group: matching score
num_20 = Number(flatten(filter_6))
panel_25 = Panel(num_20)

# ----
division_6 = Division(A=num_20, B=num_15)

# ---- group: objective printouts
num_21 = Number(num_20)
format = Format(Format="{0:0.00}", Culture=127, Data0=num_21)
num_22 = Number(num_15)
num_23 = Number(num_13)
larger = LargerThan(FirstNumber=num_21, SecondNumber=num_11)  # -> LargerThan, OrEqualTo
line_inventory_curves_3 = RemoteReceiver(line_inventory_curves)
crv_design_curves_4 = RemoteReceiver(crv_design_curves)
int_dome_count_4 = RemoteReceiver(int_dome_count)
num_24 = Number(num_23)
num_25 = Number(division_6)
format_2 = Format(Format="{0:0.00}", Culture=127, Data0=num_22)
format_3 = Format(Format="{0:0.00}", Culture=127, Data0=num_24)
format_4 = Format(Format="{0:0.00}", Culture=127, Data0=num_25)
filter_7 = StreamFilter(Gate=larger.OrEqualTo, Stream0=format, Stream1="infeasible")
lng_4 = ListLength(List=line_inventory_curves_3)
lng_5 = ListLength(List=crv_design_curves_4)
int_7 = Integer(int_dome_count_4)
concat_3 = Concatenate(FragmentA="# inventory: ", FragmentB=lng_4)
concat_4 = Concatenate(FragmentA="# of domes: ", FragmentB=int_7)
concat_5 = Concatenate(FragmentA="# design: ", FragmentB=lng_5)
concat_6 = Concatenate(FragmentA="matching score: ", FragmentB=filter_7)
concat_7 = Concatenate(FragmentA="floor area: ", FragmentB=format_2)
concat_8 = Concatenate(FragmentA="material coverage: ", FragmentB=format_3)
concat_9 = Concatenate(FragmentA="objective: ", FragmentB=format_4)
num_inventory_label_x_coordinate_3 = RemoteReceiver(num_inventory_label_x_coordinate)
pt_8 = ConstructPoint(XCoordinate=num_inventory_label_x_coordinate_3, YCoordinate=Slider(17.78, range=0..100), ZCoordinate=0)
concat_10 = Concatenate(
    FragmentA=concat_3,
    FragmentF=concat_4,
    FragmentB=concat_5,
    FragmentB_2=concat_6,
    FragmentE=concat_7,
    FragmentI=concat_8,
    FragmentK=concat_9)
xy_2 = XYPlane(Origin=pt_8)
tag_3 = TextTag3D(Location=xy_2, Text=concat_10, Size=Slider(1.3, range=0.5..5), Justification=7)

# ----
filter_8 = StreamFilter(Gate=use_julia_backend, Stream0=int_6, Stream1=int_5)

# ---- group: inventory color
# design lines
int_8 = Integer(simplify(graft(filter_8)))
geo_2 = Geometry(simplify(graft(geo)))
len_4 = Length(Curve=crv_7)
crv_9 = Curve(simplify(graft(crv_8)))
S = Shader([{diffuse=RGB(11, 125, 222), emission=RGB(3, 38, 67), shine=0.5, specular=RGB(255, 255, 255), transparency=0}, {diffuse=RGB(222, 37, 11), emission=RGB(67, 11, 3), shine=0.5, specular=RGB(255, 255, 255), transparency=0}, {diffuse=RGB(71, 222, 11), emission=RGB(21, 67, 3), shine=0.5, specular=RGB(255, 255, 255), transparency=0}, {diffuse=RGB(222, 194, 11), emission=RGB(67, 58, 3), shine=0.5, specular=RGB(255, 255, 255), transparency=0}])
crv_10 = Curve(simplify(graft(crv_5)))
pframe = PerpFrame(Curve=reparameterize(crv_10), Parameter="0.5")
pt_9 = Point(pframe)
panel_26 = Panel(""".5
.1""")
swatch = ColourSwatch(SwatchColor=RGB(12, 203, 142))
swatch_2 = ColourSwatch(SwatchColor=RGB(90, 169, 172))
panel_27 = Panel("""5.0
1.0""")
gate = StreamGate(Stream=pt_9, Gate=viz_matching_line)  # -> Target0, Target1
Z_9 = UnitZ(Factor=Slider(11.8, range=0..20))
xy_3 = XYPlane(Origin=Point(0, 0, 0))
move_13 = Move(Geometry=xy_3, Motion=Z_9)  # -> Geometry, Transform

# ---- group: inventory color / A index -> B index
int_9 = Integer(int_8)

# ---- group: inventory color (continued)
int_10 = Integer(int_9)

# ---- group: inventory color / inventory -> design
python_6 = GhPythonScript(int_tree=int_10)  # -> out, a; inputs int_tree: tree of Int32
# ---------- python_6: Python ----------
import Rhino.Geometry.Plane as Plane
import Rhino.Geometry.Point3d as Point3d
import Rhino.Geometry.Vector3d as Vector3d
import Rhino.Geometry.Quaternion as Quat
import Grasshopper.DataTree as DataTree # Add, AddRange(list, GHPath(i, j))
import Grasshopper.Kernel.Data.GH_Path as GHPath
import System
from System.Collections.Generic import List

from ghpythonlib.treehelpers import list_to_tree, tree_to_list
import os
import json
##############################

data_from_branch = tree_to_list(int_tree, lambda x:x)
branch_from_data = DataTree[int]()
for i, data in enumerate(data_from_branch):
    for d in data:
        branch_from_data.Add(i, GHPath(d))
a = branch_from_data
# ---------- end python_6 ----------

# ---- group: inventory color (continued)
tstat_3 = TreeStatistics(Tree=python_6.a)  # -> Paths, Length, Count
split_8 = SplitTree(Data=graft_2, Masks=flatten(tstat_3.Paths))  # -> Positive, Negative
split_9 = SplitTree(Data=crv_9, Masks=flatten(tstat_3.Paths))  # -> Positive, Negative
item_14 = ListItem(List=len_4, Index=python_6.a, Wrap=True)
end_2 = EndPoints(Curve=split_9.Positive)  # -> Start, End
num_26 = Number(item_14)
len_5 = Length(Curve=split_9.Positive)
pt_10 = Point(end_2.Start)
split_10 = SplitTree(Data=geo_2, Masks=flatten(tstat_3.Paths))  # -> Positive, Negative
ma_3 = MassAddition(Input=num_26)  # -> Result, PartialResults
xy_4 = XYPlane(Origin=pt_10)
division_7 = Division(A=num_26, B=len_5)
subtraction_9 = Subtraction(A=ma_3.PartialResults, B=num_26)
scale_nu = ScaleNU(Geometry=split_10.Positive, Plane=xy_4, ScaleX=1, ScaleY=1, ScaleZ=division_7)  # -> Geometry, Transform
Z_10 = UnitZ(Factor=subtraction_9)
move_14 = Move(Geometry=scale_nu.Geometry, Motion=Z_10)  # -> Geometry, Transform
geo_3 = Geometry(move_14.Geometry)
clean = CleanTree(RemoveNulls=True, RemoveInvalid=True, RemoveEmpty=False, Tree=geo_3)
int_11 = Integer(python_6.a)
lng_6 = ListLength(List=clean)
col_6 = Colour(split_8.Positive)
S_2 = Shader(col_6)
python_7 = GhPythonScript(geos=move_14.Geometry, design_from_inventory=int_11)  # -> out, geo_from_design, design_from_cutoff; inputs geos: tree of GeometryBase, design_from_inventory: tree
# ---------- python_7: Python ----------
import Rhino.Geometry.Plane as Plane
import Rhino.Geometry.Point3d as Point3d
import Rhino.Geometry.Vector3d as Vector3d
import Rhino.Geometry.Quaternion as Quat
import Grasshopper.DataTree as DataTree # Add, AddRange(list, GHPath(i, j))
import Grasshopper.Kernel.Data.GH_Path as GHPath
import System
from System.Collections.Generic import List
import Rhino.Geometry.GeometryBase as GeometryBase

from ghpythonlib.treehelpers import list_to_tree, tree_to_list
import os
import json
##############################

# total_num_design = design_from_inventory.DataCount
geo_from_design = DataTree[GeometryBase]()
design_from_cutoff = DataTree[bool]()

for inv_path in geos.Paths:
    num_design = len(geos.Branch(inv_path))
    for d_id, geo in zip(design_from_inventory.Branch(inv_path), geos.Branch(inv_path)):
        geo_from_design.Add(geo, GHPath(d_id))
        design_from_cutoff.Add(num_design>1, GHPath(d_id))
# ---------- end python_7 ----------
python_8 = GhPythonScript(materials=S_2, design_from_inventory=int_11)  # -> out, mat_from_design; inputs materials: tree, design_from_inventory: tree
# ---------- python_8: Python ----------
import Rhino.Geometry.Plane as Plane
import Rhino.Geometry.Point3d as Point3d
import Rhino.Geometry.Vector3d as Vector3d
import Rhino.Geometry.Quaternion as Quat
import Grasshopper.DataTree as DataTree # Add, AddRange(list, GHPath(i, j))
import Grasshopper.Kernel.Data.GH_Path as GHPath
import System
from System.Collections.Generic import List
import Rhino.Geometry.GeometryBase as GeometryBase
import Rhino.Display.DisplayMaterial as DisplayMaterial
from Grasshopper.Kernel.Types import GH_Material

from ghpythonlib.treehelpers import list_to_tree, tree_to_list
import os
import json
##############################

# total_num_design = design_from_inventory.DataCount
mat_from_design = DataTree[GH_Material]()

for inv_path in materials.Paths:
    num_design = len(materials.Branch(inv_path))
    for d_id, geo in zip(design_from_inventory.Branch(inv_path), materials.Branch(inv_path)):
        mat_from_design.Add(GH_Material(geo), GHPath(d_id))
# ---------- end python_8 ----------
repeat = RepeatData(Data=S, Length=lng_6)  # -> simplify(Data)
geo_4 = Geometry(python_7.geo_from_design)
volume_6 = Volume(Geometry=geo_4)  # -> Volume, Centroid
xy_5 = XYPlane(Origin=volume_6.Centroid)
shader = Shader(python_8.mat_from_design)
bool = Boolean(python_7.design_from_cutoff)
orient_2 = Orient(Geometry=geo_4, Source=xy_5, Target=pframe)  # -> Geometry, Transform
gate_2 = StreamGate(Stream=volume_6.Centroid, Gate=viz_matching_line)  # -> Target0, Target1
ln_5 = Line(StartPoint=gate.Target1, EndPoint=volume_6.Centroid)
project_3 = Project(Geometry=gate_2.Target0, Plane=move_13.Geometry)  # -> Geometry, Transform
dots_3 = DotDisplay(Point=flatten(project_3.Geometry), Colour=swatch, Size=Slider(0.3, range=0..1))

# ---- group: inventory color / Visualize Just Matched Elements
preview_3 = CustomPreview(Geometry=clean, Material=col_6)

# ---- group: inventory color / viz matching lines
dispatch = Dispatch(List=flatten(ln_5), DispatchPattern=flatten(bool))  # -> ListA, ListB
dash = DashPattern(Curve=dispatch.ListA, Pattern=panel_26)  # -> simplify(Dashes), Gaps
dash_2 = DashPattern(Curve=dispatch.ListB, Pattern=panel_26)  # -> simplify(Dashes), Gaps
preview_4 = CustomPreview(Geometry=dash_2.Dashes, Material=swatch)
preview_5 = CustomPreview(Geometry=orient_2.Geometry, Material=shader)
preview_6 = CustomPreview(Geometry=dash.Dashes, Material=swatch_2)

# ----
number_slider_12 = Slider(80, range=0..164)  # disabled
tstat_4 = TreeStatistics(Tree=orient_2.Geometry)  # -> Paths, Length, Count; disabled
item_15 = ListItem(List=flatten(bool), Index=number_slider_12, Wrap=True)  # disabled
item_16 = ListItem(List=tstat_4.Paths, Index=number_slider_12, Wrap=True)  # disabled
item_17 = ListItem(List=flatten(ln_5), Index=number_slider_12, Wrap=True)  # disabled
branch_3 = TreeBranch(Tree=orient_2.Geometry, Path=item_16, MaintainPaths=True)  # disabled
dash_3 = DashPattern(Curve=item_17, Pattern=panel_26)  # -> simplify(Dashes), Gaps; disabled
branch_4 = TreeBranch(Tree=shader, Path=item_16, MaintainPaths=True)  # disabled
filter_9 = StreamFilter(Gate=item_15, Stream0=swatch, Stream1=swatch_2)  # disabled
preview_7 = CustomPreview(Geometry=dash_3.Dashes, Material=filter_9)  # disabled
preview_8 = CustomPreview(Geometry=branch_3, Material=branch_4)  # disabled

# ==== cluster Cluster
domain = ClusterInput()
deconstruct_domain = DeconstructDomain(Domain=domain)  # -> Start, End
subtraction = Subtraction(A=deconstruct_domain.End, B=deconstruct_domain.Start)
result = ClusterOutput(subtraction)

# ==== cluster Cluster_2
list = ClusterInput()
size = ClusterInput()
partition_list = PartitionList(List=list, Size=size)
list_item = ListItem(List=partition_list, Index=0, Wrap=True)
shift_paths = ShiftPaths(Data=list_item, Offset=-1)
data = ClusterOutput(shift_paths)

# ==== cluster Cluster_3
number = ClusterInput()
number_2 = Number(number)
sort_list = SortList(Keys=flatten(number_2))  # -> Keys, ValuesValuesA
list_item = ListItem(List=sort_list.Keys, Index=0, Wrap=True)  # -> Item1, Item
domain_end = ClusterInput()
construct_domain = ConstructDomain(DomainStart=list_item.Item, DomainEnd=list_item.Item1)
construct_domain_2 = ConstructDomain(DomainStart="0", DomainEnd=domain_end)
remap_numbers = RemapNumbers(Value=number_2, Source=construct_domain, Target=construct_domain_2)  # -> Mapped, Clipped
mapped = ClusterOutput(remap_numbers.Mapped)
